# Grasshopper definition metro.gh (Grasshopper 1.0.7)
# plug-ins: LunchBox, Urbano

file_path = FilePath("C:\Users\dawar\projects\munich_new_metro_pbd\data\munich.csv")
read_file = ReadFile(File=file_path, PerLineParse=True)
read_file_2 = ReadFile(File="C:\Users\dawar\projects\munich_new_metro_pbd\data\metro_stations.csv", PerLineParse=True)
read_csv = ReadCSV(CSVString=read_file, Delimiter=";")  # -> Headers, Values
panel = Panel(read_csv.Values)
read_csv_2 = ReadCSV(CSVString=read_file_2, Delimiter=";")  # -> Headers, Values
panel_2 = Panel(read_csv.Headers)

# ---- group: Generators
read_file_3 = ReadFile(File="C:\Users\dawar\projects\munich_new_metro_pbd\data\generators.csv", PerLineParse=True)
read_csv_3 = ReadCSV(CSVString=read_file_3, Delimiter=",")  # -> Headers, Values
panel_3 = Panel(read_csv_3.Headers)
explode_tree = ExplodeTree(Data=read_csv_3.Values)  # -> Branch0, Branch1, Branch2, Branch3, Branch4
construct_point = ConstructPoint(XCoordinate=explode_tree.Branch2, YCoordinate=explode_tree.Branch1, ZCoordinate=expr("0", 10))
project_geographic_point = ProjectGeographicPoint(Point=construct_point, Projection="WSG84 -> UTM", UTMZone="32")  # -> Out, UTMZone
panel_4 = Panel(construct_point)
generators = Point(project_geographic_point.Out)
unit_z = UnitZ(Factor=1000)
move = Move(Geometry=generators, Motion=unit_z)  # -> Geometry, Transform

# ----
read_metro_connections_csv = ReadFile(File="C:\Users\dawar\projects\munich_new_metro_pbd\data\metro_connections.csv", PerLineParse=True)
panel_5 = Panel(read_csv_2.Headers)
explode_tree_2 = ExplodeTree(Data=read_csv_2.Values)  # -> Branch0, Branch1, Branch2
explode_tree_3 = ExplodeTree(Data=read_csv.Values)  # -> Branch0, Branch1, Branch2, Branch3, Branch4, Branch5
read_csv_4 = ReadCSV(CSVString=read_metro_connections_csv, Delimiter=";")  # -> Headers, Values
panel_6 = Panel(explode_tree_3.Branch0)
construct_point_2 = ConstructPoint(XCoordinate=explode_tree_2.Branch2, YCoordinate=explode_tree_2.Branch1, ZCoordinate=expr("0", 10))
panel_7 = Panel(explode_tree_3.Branch2)
population = Number(explode_tree_3.Branch5)
explode_tree_4 = ExplodeTree(Data=read_csv_4.Values)  # -> Branch0, Branch1
panel_8 = Panel(explode_tree_3.Branch1)
bounds = Bounds(Numbers=population)
panel_9 = Panel(population)
project_geographic_point_2 = ProjectGeographicPoint(Point=construct_point_2, Projection="WSG84 -> UTM", UTMZone="32")  # -> Out, UTMZone
panel_10 = Panel(construct_point_2)
construct_domain = ConstructDomain(DomainStart=Slider(100, range=1..3000), DomainEnd=Slider(1000, range=1..3000))
parse_polygon = CSharpScript(x=explode_tree_3.Branch2)  # -> out, A; inputs x: String
# ---------- parse_polygon: C# ----------
    var outList = new List<Point3d>();
    var cleanString = x.Substring(10, x.Length - 2 - 10);
    var textCoords = cleanString.Split(',');
    foreach (string textCoord in textCoords){
      var coords = textCoord.Trim().Split(' ');
      //Print(textCoord);
      //Print(coords.Length.ToString());
      //Print("-------");
      outList.Add(new Point3d(double.Parse(coords[0]), double.Parse(coords[1]), 0));
    }
    A = outList;
# ---------- end parse_polygon ----------
panel_11 = Panel(parse_polygon.out)
unit_z_2 = UnitZ(Factor=1000)
existing_metro_stations = Point(project_geographic_point_2.Out)
item = ListItem(List=existing_metro_stations, Index=explode_tree_4.Branch1, Wrap=False)
item_2 = ListItem(List=existing_metro_stations, Index=explode_tree_4.Branch0, Wrap=False)
ln = Line(StartPoint=item_2, EndPoint=item)
remap_numbers = RemapNumbers(Value=population, Source=bounds, Target=construct_domain)  # -> Mapped, Clipped
project_geographic_point_3 = ProjectGeographicPoint(Point=parse_polygon.A, Projection="WSG84 -> UTM")  # -> Out, UTMZone
panel_12 = Panel(parse_polygon.A)
unit_z_3 = UnitZ(Factor=1000)
panel_13 = Panel(ln)
move_2 = Move(Geometry=ln, Motion=unit_z_2)  # -> Geometry, Transform
unit_z_4 = UnitZ(Factor=remap_numbers.Mapped)
move_3 = Move(Geometry=existing_metro_stations, Motion=unit_z_3)  # -> Geometry, Transform
colour = Colour(RGB(0, 87, 85))
preview = CustomPreview(Geometry=move_2.Geometry, Material=colour)
panel_14 = Panel(project_geographic_point_3.Out)
polyline = PolyLine(Vertices=project_geographic_point_3.Out, Closed=True)
boundary_surfaces = BoundarySurfaces(Edges=polyline)
colour_2 = Colour(RGB(0, 161, 158))
custom_preview = CustomPreview(Geometry=move.Geometry, Material=colour_2)
map2d = Surface(flatten(boundary_surfaces))
extrude = Extrude(Base=map2d, Direction=unit_z_4)

# ---- group: Density
area = Area(Geometry=map2d)  # -> Area, Centroid
panel_15 = Panel(area.Area)  # disabled
division = Division(A=population, B=area.Area)

# ---- group: Sample Points
mesh_join = MeshJoin(Meshes=extrude)
bounding_box = BoundingBox(Content=mesh_join, Plane=PlaneXY(0, 0, 0))  # -> Box, Box_2
deconstruct_brep = DeconstructBrep(Brep=bounding_box.Box)  # -> Faces, Edges, Vertices
bounds_2 = ListItem(List=deconstruct_brep.Faces, Index=Slider(4, range=0..5), Wrap=True)
precision = Slider(329, range=100..2000)
dimensions = Dimensions(Surface=bounds_2)  # -> UDimension, VDimension
division_2 = Division(A=dimensions.UDimension, B=precision)
division_3 = Division(A=dimensions.VDimension, B=precision)
divide_surface = DivideSurface(Surface=bounds_2, UCount=division_2, VCount=division_3)  # -> Points, Normals, Parameters

# ----
panel_16 = Panel(division)  # disabled
bounds_3 = Bounds(Numbers=division)
panel_17 = Panel(bounds_3)  # disabled
deconstruct_domain = DeconstructDomain(Domain=bounds_3)  # -> Start, End
gradient = Gradient(
    LowerLimit=deconstruct_domain.Start,
    UpperLimit=deconstruct_domain.End,
    Parameter=division,
    stops=[0: RGB(0, 128, 0), 0.5: RGB(255, 255, 0), 1: RGB(255, 0, 0)])
custom_preview_2 = CustomPreview(Geometry=extrude, Material=gradient)
multiplication = Multiplication(A=precision, B=precision)
# 2x number of new metro stations
gene_pool = GenePool(Decimals=2, Maximum=100, Minimum=0, Value=[55.48, 46.16, 38, 52.7, 37.06, 54.08, 36.03, 52.74, 46.19, 34.69])

# ---- group: Map Domain
sort_points = SortPoints(Points=deconstruct_brep.Vertices)  # -> Points, Indices
list_item = ListItem(List=sort_points.Points, Index=0, Wrap=True)
list_item_2 = ListItem(List=sort_points.Points, Index=-1, Wrap=True)
deconstruct = Deconstruct(Point=list_item)  # -> XComponent, YComponent, ZComponent
deconstruct_2 = Deconstruct(Point=list_item_2)  # -> XComponent, YComponent, ZComponent
construct_domain_2 = ConstructDomain(DomainStart=deconstruct.XComponent, DomainEnd=deconstruct_2.XComponent)
construct_domain_3 = ConstructDomain(DomainStart=deconstruct.YComponent, DomainEnd=deconstruct_2.YComponent)

# ----
galapagos = Galapagos(fitness=addition_2, gene=gene_pool)
list_length = ListLength(List=gene_pool)
series = Series(Start=0, Step=1, Count=list_length)

# ---- group: Population Density Samples
point_in_breps = PointInBreps(Brep=extrude, Point=divide_surface.Points, Strict=False)  # -> Inside, Index
panel_18 = Panel(point_in_breps.Inside)  # disabled
panel_19 = Panel(point_in_breps.Index)  # disabled
region_sample = ListItem(List=extrude, Index=point_in_breps.Index, Wrap=False)
population_sample = ListItem(List=population, Index=point_in_breps.Index, Wrap=False)
area_2 = Area(Geometry=region_sample)  # -> Area, Centroid
panel_20 = Panel(population_sample)
panel_21 = Panel(region_sample)  # disabled
division_4 = Division(A=population_sample, B=area_2.Area)
population_density_sample = Number(division_4)
panel_22 = Panel(population_density_sample)  # disabled

# ----
modulus = Modulus(A=series, B=2)
dispatch = Dispatch(List=gene_pool, DispatchPattern=modulus)  # -> ListA, ListB
remap_numbers_2 = RemapNumbers(Value=dispatch.ListA, Source=Domain(0, 100), Target=construct_domain_2)  # -> Mapped, Clipped
remap_numbers_3 = RemapNumbers(Value=dispatch.ListB, Source=Domain(0, 100), Target=construct_domain_3)  # -> Mapped, Clipped
existing_metro_stations_2 = Point(existing_metro_stations)
construct_point_3 = ConstructPoint(XCoordinate=remap_numbers_2.Clipped, YCoordinate=remap_numbers_3.Clipped, ZCoordinate=0)
unit_z_5 = UnitZ(Factor=1000)
move_4 = Move(Geometry=construct_point_3, Motion=unit_z_5)  # -> Geometry, Transform
merge_lists = CSharpScript(listA=existing_metro_stations_2, listB=construct_point_3)  # -> out, mergedList; inputs listA: list of Point3d, listB: list of Point3d
# ---------- merge_lists: C# ----------
    var list = new List<Point3d>();
    list.AddRange(listA);
    list.AddRange(listB);
    mergedList = list;
# ---------- end merge_lists ----------
colour_3 = Colour(RGB(0, 0, 255))
panel_23 = Panel(merge_lists.mergedList)
custom_preview_3 = CustomPreview(Geometry=move_4.Geometry, Material=colour_3)
sigma = Z(1000)
sum_generators = CSharpScript(stations=merge_lists.mergedList, generators=generators, generatorValues=explode_tree.Branch3, sigma=sigma)  # -> out, value; inputs stations: list of Point3d, generators: list of Point3d, generatorValues: list of Int32, sigma: Double
# ---------- sum_generators: C# ----------
    double sigmaSq = sigma * sigma;
    double val = 0;
    foreach(var station in stations){
      for(int i = 0; i < generators.Count; i++){
        Point3d point = generators[i];
        int numPeople = generatorValues[i];
        double distSq = point.DistanceToSquared(station);
        //Print(string.Format("Density {0} dist {1}", density, distSq));
        val += numPeople * Math.Exp(-distSq / sigmaSq);
      }
    }
    value = val;
# ---------- end sum_generators ----------
panel_24 = Panel(sum_generators.value)
integrate_population = CSharpScript(
    samplePoints=flatten(divide_surface.Points),
    sampleValues=flatten(population_density_sample),
    stationsPos=merge_lists.mergedList,
    sigma=sigma,
    dA=multiplication)  # -> out, value; inputs samplePoints: list of Point3d, sampleValues: list of Double, stationsPos: list of Point3d, sigma: Double, dA: Double
# ---------- integrate_population: C# ----------
    double sigmaSq = sigma * sigma;
    double val = 0;
    foreach(var station in stationsPos){
      for(int i = 0; i < samplePoints.Count; i++){
        Point3d point = samplePoints[i];
        double density = sampleValues[i];
        double distSq = point.DistanceToSquared(station);
        //Print(string.Format("Density {0} dist {1}", density, distSq));
        val += density * Math.Exp(-distSq / sigmaSq);
      }
    }
    value = dA * val;
# ---------- end integrate_population ----------
point_in_breps_2 = PointInBreps(Brep=extrude, Point=construct_point_3, Strict=False)  # -> Inside, Index
panel_25 = Panel(point_in_breps_2.Inside)
panel_26 = Panel(integrate_population.out)
c_script = CSharpScript(newStations=construct_point_3, allStations=merge_lists.mergedList, inside=point_in_breps_2.Inside)  # -> out, A; inputs newStations: list of Point3d, allStations: list of Point3d, inside: list of Boolean
# ---------- c_script: C# usings ----------
using System.Linq;
# ---------- c_script: C# ----------
    double res = 0d;
    for(int i = 0; i < newStations.Count(); i++){
      var p = newStations[i];
      if(inside[i]){
        res += Math.Min(1000, Math.Sqrt(allStations.Min(x => x == p ? 999999999 : x.DistanceToSquared(p))));
      } else {
        res -= 1e9;
      }
    }
    A = res / newStations.Count();
# ---------- end c_script ----------
panel_27 = Panel(integrate_population.value)
multiplication_2 = Multiplication(A=c_script.A, B=Slider(1000, range=1..1000))
addition = Addition(A=integrate_population.value, B=multiplication_2)
panel_28 = Panel(multiplication_2)
panel_29 = Panel(addition)
addition_2 = Addition(A=addition, B=sum_generators.value)
panel_30 = Panel(addition_2)
